% Simulink data dictionary ModelDictionary.sldd

ActualAngles = Simulink.Bus()
  ActualAngle_LHFE: double
  ActualAngle_LKFE: double
  ActualAngle_RHFE: double
  ActualAngle_RKFE: double

ActualDynamics = Simulink.Bus()
  ActualAngles: Bus: ActualAngles
  ActualVelocities: Bus: ActualVelocities
  ActualTorques: Bus: ActualTorques

ActualTorques = Simulink.Bus()
  ActualTorque_LHFE: double
  ActualTorque_LKFE: double
  ActualTorque_RHFE: double
  ActualTorque_RKFE: double

ActualVelocities = Simulink.Bus()
  ActualVelocity_LHFE: double
  ActualVelocity_LKFE: double
  ActualVelocity_RHFE: double
  ActualVelocity_RKFE: double

CalculatedDynamics = Simulink.Bus()
  CalculatedAngles: Bus: CalculatedAngles
  CalculatedVelocities: Bus: CalculatedVelocities
  CalculatedTorques: Bus: CalculatedTorques

Data = Simulink.Bus()
  Statuswords: Bus: Statuswords
  ActualDynamics: Bus: ActualDynamics
  UserMISOs: Bus: UserMISOs
  TuningStatuses: Bus: TuningStatuses
  ErrorSOMANETs: Bus: ErrorSOMANETs
  Phase_Currents: Bus: Phase_Currents
  Status_OpModeSOMANETs: Bus: Status_OpModeSOMANETs
  TimeStampSOMANETs: Bus: TimeStampSOMANETs
  Status_Temperatures: Bus: Status_Temperatures
  Status_PDB: Bus: Status_PDB
  Status_BMS: Bus: Status_BMS
  TargetDynamics: Bus: TargetDynamics
  Error: Bus: Error
  GaitPhase: double
  Controlwords: Bus: Controlwords
  OpModes: Bus: OpModes
  TuningCommands: Bus: TuningCommands
  UserMOSIs: Bus: UserMOSIs
  MAXTorques: Bus: MAXTorques
  ActualStateMARCH: double
  QuickStop: double
  MasterOP: double
  DesiredState: double
  ErrorInputDevice: double
  ConfigSOMANETs: Bus: ConfigSOMANETs
  CalculatedDynamics: Bus: CalculatedDynamics

UserMISOs = Simulink.Bus()
  UserMISO_LHFE: double
  UserMISO_LKFE: double
  UserMISO_RHFE: double
  UserMISO_RKFE: double

Sig = Simulink.Signal()

Controlwords = Simulink.Bus()
  Controlword_LHFE: double
  Controlword_LKFE: double
  Controlword_RHFE: double
  Controlword_RKFE: double

CalculatedAngles = Simulink.Bus()
  CalculatedAngle_LHFE: double
  CalculatedAngle_LKFE: double
  CalculatedAngle_RHFE: double
  CalculatedAngle_RKFE: double

CalculatedTorques = Simulink.Bus()
  CalculatedTorque_LHFE: double
  CalculatedTorque_LKFE: double
  CalculatedTorque_RHFE: double
  CalculatedTorque_RKFE: double

CalculatedVelocities = Simulink.Bus()
  CalculatedVelocity_LHFE: double
  CalculatedVelocity_LKFE: double
  CalculatedVelocity_RHFE: double
  CalculatedVelocity_RKFE: double

ErrorSOMANETs = Simulink.Bus()
  ErrorSOMANET_LHFE: double
  ErrorSOMANET_LKFE: double
  ErrorSOMANET_RHFE: double
  ErrorSOMANET_RKFE: double

MAXTorques = Simulink.Bus()
  MAXTorque_LHFE: double
  MAXTorque_LKFE: double
  MAXTorque_RHFE: double
  MAXTorque_RKFE: double

Phase_Currents = Simulink.Bus()
  PhaseB_Current_LHFE: double
  PhaseC_Current_LHFE: double
  PhaseB_Current_LKFE: double
  PhaseC_Current_LKFE: double
  PhaseB_Current_RHFE: double
  PhaseC_Current_RHFE: double
  PhaseB_Current_RKFE: double
  PhaseC_Current_RKFE: double

Status_BMS = Simulink.Bus()
  StateBMS: double
  StateChargeBattery: double
  TempBattery: double
  MINVoltCell: double
  MAXVoltCell: double

Status_OpModeSOMANETs = Simulink.Bus()
  Status_OpModeSOMANET_LHFE: double
  Status_OpModeSOMANET_LKFE: double
  Status_OpModeSOMANET_RHFE: double
  Status_OpModeSOMANET_RKFE: double

Status_PDB = Simulink.Bus()
  StatePDB: double
  CurrentBattery: double
  VoltageBattery: double
  TempDCDC: double

Status_Temperatures = Simulink.Bus()
  TempSOMANET_LHFE: double
  TempSOMANET_LKFE: double
  TempSOMANET_RHFE: double
  TempSOMANET_RKFE: double
  TempMotor_LHFE: double
  TempMotor_LKFE: double
  TempMotor_RHFE: double
  TempMotor_RKFE: double

Statuswords = Simulink.Bus()
  Statusword_LHFE: double
  Statusword_LKFE: double
  Statusword_RHFE: double
  Statusword_RKFE: double

TargetAngles = Simulink.Bus()
  TargetAngle_LHFE: double
  TargetAngle_LKFE: double
  TargetAngle_RHFE: double
  TargetAngle_RKFE: double

TargetDynamics = Simulink.Bus()
  TargetAngles: Bus: TargetAngles
  TargetVelocities: Bus: TargetVelocities
  TargetTorques: Bus: TargetTorques

TargetTorques = Simulink.Bus()
  TargetTorque_LHFE: double
  TargetTorque_LKFE: double
  TargetTorque_RHFE: double
  TargetTorque_RKFE: double

TargetVelocities = Simulink.Bus()
  TargetVelocity_LHFE: double
  TargetVelocity_LKFE: double
  TargetVelocity_RHFE: double
  TargetVelocity_RKFE: double

TimeStampSOMANETs = Simulink.Bus()
  TimeStampSOMANET_LHFE: double
  TimeStampSOMANET_LKFE: double
  TimeStampSOMANET_RHFE: double
  TimeStampSOMANET_RKFE: double

TuningCommands = Simulink.Bus()
  TuningCommand_LHFE: double
  TuningCommand_LKFE: double
  TuningCommand_RHFE: double
  TuningCommand_RKFE: double

TuningStatuses = Simulink.Bus()
  TuningStatus_LHFE: double
  TuningStatus_LKFE: double
  TuningStatus_RHFE: double
  TuningStatus_RKFE: double

UserMOSIs = Simulink.Bus()
  UserMOSI_LHFE: double
  UserMOSI_LKFE: double
  UserMOSI_RHFE: double
  UserMOSI_RKFE: double

StateElectronics = Simulink.Bus()
  StatePDB: double
  StateBMS: double

DesiredOpModes = Simulink.Bus()
  DesiredOpMode_LHFE: double
  DesiredOpMode_LKFE: double
  DesiredOpMode_RHFE: double
  DesiredOpMode_RKFE: double

ConfigSOMANET = Simulink.Bus()
  AngleOffset: double
  PolePairs: double
  MINPosLimit: double
  MAXPosLimit: double
  MAXSpeed: double
  MAXTorque: double
  PositionKp: double
  PositionKi: double
  PositionKd: double
  PositionIntegralLimit: double
  VelocityKp: double
  VelocityKi: double
  VelocityKd: double
  VelocityIntegralLimit: double
  ErrorStatus: double
  BreakReleaseStrategy: double
  ErrorSensor: double
  ErrorMotionControl: double
  RatedTorque: double

ConfigSOMANETs = Simulink.Bus()
  ConfigSOMANET_LHFE: Bus: ConfigSOMANET
  ConfigSOMANET_LKFE: Bus: ConfigSOMANET
  ConfigSOMANET_RHFE: Bus: ConfigSOMANET
  ConfigSOMANET_RKFE: Bus: ConfigSOMANET